% Simulink data dictionary EvPowertrainControllerDD.sldd

Accessory = struct(Power=1000)
CS_SOC_Setpoint = 50
CS_Thermostat_Off = -5
CS_Thermostat_On = 0
CS_Thermostat_Power = [25000 15000 5000 0]
CS_Thermostat_SOC = [0 50 55 100]

DCDC = struct(
  Output_Voltage_Ref=700,
  Output_Voltage_Droop=0.01,
  Max_Current=1250,
  Rated_Output_Power=400,
  Efficiency=96,
  Fixed_loss=1.0e-6)

Diff_ratio = 3.421
GB_ratio = 2
OptimPwrVec = Simulink.Parameter([2094.395 8377.58 13351.77 19896.75 31415.93 40840.7 56548.67 73303.83 87964.59 95294.98])
OptimSpdVec = Simulink.Parameter([500 1000 1500 2000 2500 3000 4000 5000 6000 6500])
OptimTrqVec = Simulink.Parameter([40 80 85 95 120 130 135 140 140 140])

Pedal = struct(
  VehSpd_steps=[0 10 20 30 40 50 60 70 80 90 100 110 120 130 140 150 160 170 180],
  AccPed_steps=[0 10 20 30 40 50 60 70 80 90 100],
  Trq_Scale=[0 10 20 30 40 50 60 70 80 90 100
   0 10 20 30 40 50 60 70 80 90 100
   0 10 20 30 40 50 60 70 80 90 100
   0 10 20 30 40 50 60 70 80 90 100
   0 10 20 30 40 50 60 70 80 90 100
   0 10 20 30 40 50 60 70 80 90 100
   0 10 20 30 40 50 60 70 80 90 100
   0 10 20 30 40 50 60 70 80 90 100
   0 10 20 30 40 50 60 70 80 90 100
   0 10 20 30 40 50 60 70 80 90 100
   0 10 20 30 40 50 60 70 80 90 100
   0 10 20 30 40 50 60 70 80 90 100
   0 10 20 30 40 50 60 70 80 90 100
   0 10 20 30 40 50 60 70 80 90 100
   0 10 20 30 40 50 60 70 80 90 100
   0 10 20 30 40 50 60 70 80 90 100
   0 10 20 30 40 50 60 70 80 90 100
   0 10 20 30 40 50 60 70 80 90 100
   0 10 20 30 40 50 60 70 80 90 100],
  Brake_gains=[0.5 0.2 0.2 0.25 0.5 0.5 0.5 0.5 0.5 0.5 0.5 0.5 0.5 0.5 0.5 0.5 0.5 0.5 0.5])

PowerLimitBuffer = 1500
SOC = struct(CD_Limit=80, CS_Limit=50)

mot = struct(
  max_trq=120,
  max_pwr=90,
  spd=[0 500 1000 1500 2000 2500 3000 3500 7161.972 7661.972 8161.972 8661.972 9161.972 9661.972 10161.97 10661.97 11161.97 11661.97 12161.97],
  trq=[120 120 120 120 120 120 120 120 120 112.1691 105.2977 99.21951 93.80477 88.95044 84.57381 80.60766 76.99685 73.69565 70.6659],
  map=struct(
    spdindex=[0 1000 2000 3000 3857 4000 5000 6000 7000 8000 9000 10000 11000 12000 12584],
    trqindex=[10 25 50 75 100 125 150 175 200 225 250 275 300 307],
    eff=[84 90 90 90 90 90 90 90 90 90 90 90 90 90 90
     84 90 93 95 95 95 96 95 95 95 95 93 93 93 93
     84 90 93 95 95 95 96 95 96 95 95 95 95 93 93
     84 90 93 95 95 95 96 96 96 95 95 95 95 93 93
     84 90 93 95 95 95 96 96 96 95 95 93 93 93 90
     84 88 90 93 93 95 95 96 95 95 95 93 93 93 90
     84 88 90 90 90 93 95 95 95 93 93 93 93 93 90
     84 88 90 90 90 90 93 93 93 93 93 93 93 93 90
     84 84 88 90 90 90 93 93 93 93 93 93 93 93 90
     84 84 88 90 90 90 90 93 93 93 93 93 93 93 90
     84 84 84 90 90 90 90 93 93 93 93 93 93 93 90
     84 84 84 88 90 90 90 93 93 93 93 93 93 93 90
     84 84 84 88 88 88 90 93 93 93 93 93 93 93 90
     84 84 84 88 88 88 90 93 93 93 93 93 93 93 90]),
  trq_cp=[120 112.1691 105.2977 99.21951 93.80477 88.95044 84.57381 80.60766 76.99685 73.69565 70.6659 90.46702 85.94367 81.85111 78.13061 74.73363 71.61972 68.75494])

p1 = Simulink.Parameter(1.522)
q1 = Simulink.Parameter(3.908)
r1 = Simulink.Parameter(8137.587)
r2 = Simulink.Parameter(0)
s1 = Simulink.Parameter(20)
s2 = Simulink.Parameter(1.6)
tire = struct(rollrad=0.3)

Batt = struct(
  init_charge=100,
  Vnom=320,
  Ah_rating=100,
  R1=0.0846,
  V1=283.3,
  Q1=10.4,
  Limit=struct(
    SOC=[0 10 20 30 40 50 60 70 80 90 100],
    Discharge=[0 15000 33000 54000 75000 90000 108000 117000 120000 120000 120000],
    Charge=[-120000 -120000 -120000 -117000 -108000 -90000 -75000 -54000 -33000 -15000 -0]),
  m=119.7,
  Cp=101.079756)