% Simulink data dictionary DrivetrainEvDD.sldd

DiffRatio = 3.421
Jmotor = 0.1
MotGbRatio = 2
Rwheel = 0.3
b_axle = Simulink.Parameter(10)
b_driveshaft = Simulink.Parameter(10)
k_axle = Simulink.Parameter(5000)
k_driveshaft = Simulink.Parameter(1000)
wc_shaft = Simulink.Parameter(0.1)