% Simulink data dictionary PowertrainBestFuelControllerDD.sldd

CONVERTER_DATA = [0 137.4652 2.232
 0.1 137.065 2.075
 0.2 135.8644 1.975
 0.3 135.6644 1.846
 0.4 137.5653 1.72
 0.5 140.3666 1.564
 0.6 145.2689 1.409
 0.7 152.8725 1.254
 0.8 162.9773 1.096
 0.81 164.2779 1.08
 0.82 166.1788 1.061
 0.83 167.9797 1.043
 0.84 170.0807 1.028
 0.85 172.782 1.012
 0.86 175.3832 1.002
 0.87 179.5852 1.002
 0.88 183.5871 1.001
 0.89 189.8901 0.998
 0.9 197.6938 0.999
 0.92 215.9024 1.001
 0.94 244.516 1.002]

DOWN_TABLE = [0 5 10 20 30
 0 5 10 20 30
 0 7.5 20 30 40
 0 7.5 20 30 40
 0 15 30 50 60
 0 15 30 50 60]

DOWN_TH_BP = [0 5 40 50 90 100]

EMAP = [-40 -44 -49 -53 -57 -61 -65 -70 -74 -78 -82
 215 117 85 66 44 29 10 -2 -13 -22 -32
 245 208 178 148 122 104 85 66 48 33 18
 264 260 241 219 193 167 152 133 119 96 85
 264 279 282 275 260 238 223 208 189 171 152
 267 290 293 297 290 275 260 256 234 212 193
 267 297 305 305 305 301 293 282 267 249 226
 267 301 308 312 319 323 319 316 297 279 253
 267 301 312 319 327 327 327 327 312 293 267
 267 301 312 319 327 334 334 334 319 305 275]

F_bp = [100 521.4286 942.8571 1364.286 1785.714 2207.143 2628.571 3050 3471.429 3892.857 4314.286 4735.714 5157.143 5578.571 6000]
NE_VEC = [800 1200 1600 2000 2400 2800 3200 3600 4000 4400 4800]

ShiftSchedule = [1 2 5 6 7 7 7 8 8 8 8 8 8 8 8
 1 2 5 6 7 7 7 8 8 8 8 8 8 8 8
 1 2 5 5 6 6 7 7 7 7 7 7 7 8 8
 1 2 4 5 6 6 6 6 6 6 7 7 7 7 7
 1 2 4 5 5 6 6 6 6 6 6 6 6 6 6
 1 1 4 5 5 5 5 5 6 5 5 6 6 6 6
 1 1 3 4 5 5 5 5 5 5 5 6 6 6 6
 1 1 2 4 4 5 5 5 5 5 5 6 6 6 6
 1 1 2 3 4 4 4 4 4 5 5 6 6 6 6
 1 1 2 3 3 3 4 4 4 5 5 6 6 6 6
 1 1 1 2 3 3 3 3 4 5 5 6 6 6 6
 1 1 1 2 2 2 2 3 4 5 5 6 6 6 6
 1 1 1 2 2 2 3 3 4 5 5 6 6 6 6
 1 1 1 1 1 2 2 3 4 5 5 6 6 6 6
 1 1 1 1 1 1 2 3 4 5 5 6 6 6 6]

TH_VEC = [0; 20; 30; 40; 50; 60; 70; 80; 90; 100]
TWAIT = 0.1
TWAIT1 = 1

Tin = [1 2
 2 2
 3 2
 4 2
 5 2
 6 0
 7 0
 8 0
 9 0
 10 0]

UP_TABLE = [7.5 25 40 50 60
 7.5 25 40 50 60
 15 35 50 60 70
 25 45 60 70 80
 40 70 90 100 110
 40 80 90 100 110]

UP_TH_BP = [0 25 35 50 90 100]
V_bp = [0 2.142857 4.285714 6.428571 8.571429 10.71429 12.85714 15 17.14286 19.28571 21.42857 23.57143 25.71429 27.85714 30]

reqTmaxT = [NaN NaN NaN NaN NaN NaN NaN NaN
 0.2857748 0.2096895 0.1716469 0.1336043 0.09556162 NaN NaN NaN
 0.6471799 0.4950093 0.418924 0.3428388 0.2667535 0.1526256 NaN NaN
 NaN 0.7803291 0.6662012 0.5520733 0.4379454 0.2667535 0.1526256 0.09556162
 NaN NaN 0.9134783 0.7613078 0.6091372 0.3808814 0.2287109 0.1526256
 NaN NaN NaN 0.9705423 0.7803291 0.4950093 0.3047961 0.2096895
 NaN NaN NaN NaN 0.951521 0.6091372 0.3808814 0.2667535
 NaN NaN NaN NaN NaN 0.7232651 0.4569667 0.3238174
 NaN NaN NaN NaN NaN 0.8373931 0.533052 0.3808814
 NaN NaN NaN NaN NaN 0.951521 0.6091372 0.4379454
 NaN NaN NaN NaN NaN NaN 0.6852225 0.4950093
 NaN NaN NaN NaN NaN NaN 0.7613078 0.5520733
 NaN NaN NaN NaN NaN NaN 0.8373931 0.6091372
 NaN NaN NaN NaN NaN NaN 0.9134783 0.6662012
 NaN NaN NaN NaN NaN NaN 0.9895636 0.7232651
 NaN NaN NaN NaN NaN NaN NaN 0.7803291
 NaN NaN NaN NaN NaN NaN NaN 0.8373931
 NaN NaN NaN NaN NaN NaN NaN 0.894457
 NaN NaN NaN NaN NaN NaN NaN 0.951521
 NaN NaN NaN NaN NaN NaN NaN NaN
 NaN NaN NaN NaN NaN NaN NaN NaN]

vehSpd = [0 2.777778 5.555556 8.333333 11.11111 13.88889 16.66667 19.44444 22.22222 25 27.77778 30.55556 33.33333 36.11111 38.88889 41.66667 44.44444 47.22222 50 52.77778 55.55556]