% Simulink data dictionary CAVE_drivingCycle.sldd

CoastDown = struct(
  Time=[0; 0.1; 0.2; 0.3; 0.4; 0.5; 0.6; 0.7; 0.8; 0.9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 1600],
  Speed=[0; 0; 0; 0; 0; 0; 0; 0; 0; 0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 0])

MCT = struct(
  Time=[0; 0.1; 0.2; 0.3; 0.4; 0.5; 0.6; 0.7; 0.8; 0.9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 24168.6],
  Speed=[0; 0; 0; 0; 0; 0; 0; 0; 0; 0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 0.0933983])

US06 = struct(
  Time=[1; 2; 3; 4; 5; 6; 7; 8; 9; 10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 600],
  Speed=[0; 0; 0; 0; 0; 0.321868; 1.126538; 1.770274; 2.735878; 9.65604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 0])

limitedMCT = struct(
  Time=[0; 0.1; 0.2; 0.3; 0.4; 0.5; 0.6; 0.7; 0.8; 0.9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 362],
  Speed=[0; 0; 0; 0; 0; 0; 0; 0; 0; 0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 104.61])

pMCT = struct(
  Time=[0; 0.1; 0.2; 0.3; 0.4; 0.5; 0.6; 0.7; 0.8; 0.9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 4103.6],
  Speed=[0; 0; 0; 0; 0; 0; 0; 0; 0; 0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 0])