% Simulink data dictionary DdBattery_32Ah.sldd

BattResistTbl = [0.008846 0.009319 0.009027 0.00847 0.01032 0.01314
 0.006389 0.006554 0.005553 0.005525 0.006043 0.007805
 0.004364 0.004101 0.00406 0.003452 0.003846 0.004517
 0.002031 0.002563 0.002532 0.00246 0.002716 0.003047
 0.001443 0.001825 0.001795 0.001778 0.001924 0.002234
 0.0005603 0.0007192 0.0006887 0.0007557 0.0007355 0.001014
 0.001028 0.001338 0.001 0.001536 0.001546 0.002789]

BattResistTempBpts = [243.1 253.1 263.1 273.1 283.1 298.1 313.1]
BattResistSocBpts = [0 0.2 0.4 0.6 0.8 1]
BattNumCellsSeries = 96
BattDischargeLimitSocBpts = [0 0.1 0.2 0.3 0.4 0.5 0.6 0.7 0.8 0.9 1]
BattDischargeLimitTbl = [0 0.6 0.8 1 1 1 1 1 1 1 1]
BattNumCellsParallel = 3
BattOpenVoltCapBpts = [0 0.1 0.2 0.3 0.4 0.5 0.6 0.7 0.8 0.9 1]
BattInitSoc = 0.9633348683
BattDischargeMaxPwr = 150000
BattChargeLimitMaxPwr = -150000
BattChargeLimitSocBpts = [0 0.1 0.2 0.3 0.4 0.5 0.6 0.7 0.8 0.9 0.96 1]
BattChargeLimitTbl = [1 1 1 1 1 1 1 1 1 1 1 0]
BattChrgCapcty = 60
BattOpenVoltTbl = [2.967621 3.403643 3.474175 3.544705 3.615234 3.685762 3.756288 3.826812 3.94527 4.071012 4.212076]