% Simulink data dictionary DdDriverLong.sldd

DriverMaxAccelFrcSpdBpts = [10 100]
DriverAccelPdlBpts = [0 1]
DriverAccelPdlTbl = [0 1]
DriverBrakePdlBpts = [0 1]
DriverSmoothTimeAvg = 0.2
DriverVelThresh = 0.4
DriverPdlRateLimitWeight = 0.1
DriverDistOptWeight = 2
DriverNumOptimIters = 20
DriverMaxAccelFrcTbl = [6000 6000]
DriverBrakeFrcTbl = [0 10000]
DriverLongLossA = 200
DriverLongLossB = 2.5
DriverLongLossC = 0.5