% Simulink data dictionary DdPassengerEv.sldd
% references DdChassis.sldd
% references DdDifferential.sldd
% references DdEnvironment.sldd
% references DdTireFront.sldd
% references DdTireRear.sldd
% references DdDriveCycleSrc.sldd
% references DdDriverLong.sldd
% references DdEvMotor.sldd
% references DdBattery_32Ah.sldd
% references DdConfigSets.sldd
% references DdEvSupervisoryCtrl.sldd
% references DdDynoRefAll.sldd
% references Dd_MTU_Map.sldd
% references DdExpRefSrc.sldd
% references CAVE_drivingCycle.sldd

Sig = Simulink.Signal()
InitSpeed = [20 0 0]
InitPos = [-34 0 0]
ConfigSetRealSim = Simulink.ConfigSet(StartTime="0", StopTime="inf", FixedStep="0.001", Solver="ode4", ProdHWDeviceType="Intel->x86-64 (Windows64)", SystemTargetFile="grt.tlc", TargetLang="C")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