% Simulink data dictionary DdDriveCycleSrc.sldd

TestScnrioDriveCycleStructs = [struct(
  Name="US EPA Urban Dynamometer Driving Schedule (FTP-72)",
  VelRef=struct(
    Tbl=[0; 0; 0; 0; 0; 0; 0; 0; 0; 0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 0],
    Bpts=[1; 2; 3; 4; 5; 6; 7; 8; 9; 10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 1372],
    TblUnits="m/s",
    BptUnits="seconds"),
  Grade=struct(UseTimeGradeBpts=1, Tbl=[0 0], Bpts=[0 1], TblUnits="rad", BptUnits="s"),
  Gear=struct(Tbl=[1 1], Bpts=[0 1])), struct(
  Name="FTP75",
  VelRef=struct(
    Tbl=[0; 0; 0; 0; 0; 0; 0; 0; 0; 0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 0],
    Bpts=[1; 2; 3; 4; 5; 6; 7; 8; 9; 10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 2474],
    TblUnits="m/s",
    BptUnits="seconds"),
  Grade=struct(UseTimeGradeBpts=1, Tbl=[0 0], Bpts=[0 1], TblUnits="rad", BptUnits="s"),
  Gear=struct(Tbl=[1 1], Bpts=[0 1])), struct(
  Name="Highway Fuel Economy Driving Schedule (HWFET)",
  VelRef=struct(
    Tbl=[0; 0; 0; 0.8940778; 2.190491; 3.621015; 5.051539; 6.482064; 7.733773; 8.761962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 0],
    Bpts=[0; 1; 2; 3; 4; 5; 6; 7; 8; 9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 765],
    TblUnits="m/s",
    BptUnits="seconds"),
  Grade=struct(UseTimeGradeBpts=1, Tbl=[0 0], Bpts=[0 1], TblUnits="rad", BptUnits="s"),
  Gear=struct(Tbl=[1 1], Bpts=[0 1])), struct(
  Name="US06",
  VelRef=struct(
    Tbl=[0; 0; 0; 0; 0; 0; 0.08940778; 0.3129272; 0.4917428; 0.7599661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 0],
    Bpts=[0; 1; 2; 3; 4; 5; 6; 7; 8; 9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 600],
    TblUnits="m/s",
    BptUnits="seconds"),
  Grade=struct(UseTimeGradeBpts=1, Tbl=[0 0], Bpts=[0 1], TblUnits="rad", BptUnits="s"),
  Gear=struct(Tbl=[1 1], Bpts=[0 1])), struct(
  Name="EPA GEM profile with 55 mph cruise",
  VelRef=struct(Tbl=[0; 24.58714; 24.58714], Bpts=[0; 120; 1028.996], TblUnits="m/s", BptUnits="s"),
  Grade=struct(
    UseTimeGradeBpts=0,
    Tbl=[0; 0; 0; 0.004999958; 0; 0; -0.0009999997; 0; 0; 0.003599984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 0],
    Bpts=[0; 2212.842; 2614.842; 3016.842; 3418.842; 3422.842; 3434.842; 3446.842; 3456.842; 3506.842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 23824.8425],
    TblUnits="rad",
    BptUnits="m"),
  Gear=struct(Tbl=[1 1], Bpts=[0 1])), struct(
  Name="EPA GEM profile with 65 mph cruise",
  VelRef=struct(Tbl=[0; 29.05753; 29.05753], Bpts=[0; 120; 893.766], TblUnits="m/s", BptUnits="s"),
  Grade=struct(
    UseTimeGradeBpts=0,
    Tbl=[0; 0; 0; 0.004999958; 0; 0; -0.0009999997; 0; 0; 0.003599984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 0],
    Bpts=[0; 2615.1775; 3017.1775; 3419.1775; 3821.1775; 3825.1775; 3837.1775; 3849.1775; 3859.1775; 3909.1775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 24227.18],
    TblUnits="rad",
    BptUnits="m"),
  Gear=struct(Tbl=[1 1], Bpts=[0 1])), struct(
  Name="Bolt 61910021 Test Data_ACM_Testing_RAW.csv",
  VelRef=struct(
    Tbl=[0.00027396354656; 0.000247104; 5.852066528e-5; 0.00032271459968; 0.0002061793184; 0.00032350854272; 0.00043392027008; 0.00037963843808; 0.00024479597472; 0.0003128743552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 0.000217831416],
    Bpts=[0.099980831; 0.199980736; 0.29998064; 0.399980545; 0.49998045; 0.599980354; 0.699980259; 0.799980164; 0.899980068; 0.999979973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 4839.995365],
    TblUnits="m/s",
    BptUnits="s"),
  Grade=struct(
    UseTimeGradeBpts=0,
    Tbl=[0; 0; 0; 0.004999958; 0; 0; -0.0009999997; 0; 0; 0.003599984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 0],
    Bpts=[0; 2615.1775; 3017.1775; 3419.1775; 3821.1775; 3825.1775; 3837.1775; 3849.1775; 3859.1775; 3909.1775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 24227.18],
    TblUnits="rad",
    BptUnits="m"),
  Gear=struct(Tbl=[1 1], Bpts=[0 1])), struct(
  Name="Bolt 61910022 Test Data_ACM_Testing_RAW.csv",
  VelRef=struct(
    Tbl=[0.00054544959744; 0.00032231271072; 0.0002238969; 0.00044895914272; 0.000576353; 0.0003861777; 0.00054176419968; 0.0006176707; 0.0006927756528; 0.00036859744416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 0.00097159852416],
    Bpts=[0.099980831; 0.199980736; 0.29998064; 0.399980545; 0.49998045; 0.599980354; 0.699980259; 0.799980164; 0.899980068; 0.999979973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 10283.79017],
    TblUnits="m/s",
    BptUnits="s"),
  Grade=struct(
    UseTimeGradeBpts=0,
    Tbl=[0; 0; 0; 0.004999958; 0; 0; -0.0009999997; 0; 0; 0.003599984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 0],
    Bpts=[0; 2615.1775; 3017.1775; 3419.1775; 3821.1775; 3825.1775; 3837.1775; 3849.1775; 3859.1775; 3909.1775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 24227.18],
    TblUnits="rad",
    BptUnits="m"),
  Gear=struct(Tbl=[1 1], Bpts=[0 1])), struct(
  Name="Bolt 61910023 Test Data_ACM_Testing_RAW.csv",
  VelRef=struct(
    Tbl=[0.00094379889472; 0.0008904934; 0.0009651115; 0.00071449106784; 0.00077653664352; 0.00076072036832; 0.00093851398784; 0.000869301; 0.00069470775968; 0.000895856984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 6.850709184e-5],
    Bpts=[0.099980831; 0.199980736; 0.29998064; 0.399980545; 0.49998045; 0.599980354; 0.699980259; 0.799980164; 0.899980068; 0.999979973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 5347.994881],
    TblUnits="m/s",
    BptUnits="s"),
  Grade=struct(
    UseTimeGradeBpts=0,
    Tbl=[0; 0; 0; 0.004999958; 0; 0; -0.0009999997; 0; 0; 0.003599984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 0],
    Bpts=[0; 2615.1775; 3017.1775; 3419.1775; 3821.1775; 3825.1775; 3837.1775; 3849.1775; 3859.1775; 3909.1775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 24227.18],
    TblUnits="rad",
    BptUnits="m"),
  Gear=struct(Tbl=[1 1], Bpts=[0 1])), struct(
  Name="Bolt 61911001 Test Data_ACM_Testing_RAW.csv",
  VelRef=struct(
    Tbl=[0.0008377221; 0.0009719065; 0.0008645574784; 0.00080417265632; 0.0008670166; 0.0007230617; 0.00072712352416; 0.0008546108384; 0.00083858937184; 0.0005697927136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 0.00040624938816],
    Bpts=[0.099980831; 0.199980736; 0.29998064; 0.399980545; 0.49998045; 0.599980354; 0.699980259; 0.799980164; 0.899980068; 0.999979973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 4219.995956],
    TblUnits="m/s",
    BptUnits="s"),
  Grade=struct(
    UseTimeGradeBpts=0,
    Tbl=[0; 0; 0; 0.004999958; 0; 0; -0.0009999997; 0; 0; 0.003599984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 0],
    Bpts=[0; 2615.1775; 3017.1775; 3419.1775; 3821.1775; 3825.1775; 3837.1775; 3849.1775; 3859.1775; 3909.1775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 24227.18],
    TblUnits="rad",
    BptUnits="m"),
  Gear=struct(Tbl=[1 1], Bpts=[0 1])), struct(
  Name="Bolt 61911002 Test Data_ACM_Testing_RAW.csv",
  VelRef=struct(
    Tbl=[0.00016016504416; 4.504777376e-5; 0.00010788282208; 3.8602619264e-5; 0.00010789668032; 0.00010778402624; 3.1837875872e-5; 1.5266103072e-5; 3.8470742464e-5; 2.063626048e-5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 0.0002138385],
    Bpts=[0.099980831; 0.199980736; 0.29998064; 0.399980545; 0.49998045; 0.599980354; 0.699980259; 0.799980164; 0.899980068; 0.999979973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 2380.99771],
    TblUnits="m/s",
    BptUnits="s"),
  Grade=struct(
    UseTimeGradeBpts=0,
    Tbl=[0; 0; 0; 0.004999958; 0; 0; -0.0009999997; 0; 0; 0.003599984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 0],
    Bpts=[0; 2615.1775; 3017.1775; 3419.1775; 3821.1775; 3825.1775; 3837.1775; 3849.1775; 3859.1775; 3909.1775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 24227.18],
    TblUnits="rad",
    BptUnits="m"),
  Gear=struct(Tbl=[1 1], Bpts=[0 1])), struct(
  Name="Bolt 61911003 Test Data_ACM_Testing_RAW.csv",
  VelRef=struct(
    Tbl=[0.00021147808352; 0.00038803429632; 0.0003173738128; 0.0004988484; 0.0002562867; 0.00035856139616; 0.00039895458944; 0.0003479268; 0.0004443417; 0.00047894256256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 0.000247104],
    Bpts=[0.099980831; 0.199980736; 0.29998064; 0.399980545; 0.49998045; 0.599980354; 0.699980259; 0.799980164; 0.899980068; 0.999979973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 1161.998873],
    TblUnits="m/s",
    BptUnits="s"),
  Grade=struct(
    UseTimeGradeBpts=0,
    Tbl=[0; 0; 0; 0.004999958; 0; 0; -0.0009999997; 0; 0; 0.003599984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 0],
    Bpts=[0; 2615.1775; 3017.1775; 3419.1775; 3821.1775; 3825.1775; 3837.1775; 3849.1775; 3859.1775; 3909.1775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 24227.18],
    TblUnits="rad",
    BptUnits="m"),
  Gear=struct(Tbl=[1 1], Bpts=[0 1])), struct(
  Name="Bolt 61911004 Test Data_ACM_Testing_RAW.csv",
  VelRef=struct(
    Tbl=[0.0004392874; 0.00060159871552; 0.0006165647; 0.0007948595; 0.000680070776; 0.0008203345; 0.0005096095; 0.000500459; 0.00062478578624; 0.00056524765792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 0.0002760839],
    Bpts=[0.099980831; 0.199980736; 0.29998064; 0.399980545; 0.49998045; 0.599980354; 0.699980259; 0.799980164; 0.899980068; 0.999979973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 2717.19739],
    TblUnits="m/s",
    BptUnits="s"),
  Grade=struct(
    UseTimeGradeBpts=0,
    Tbl=[0; 0; 0; 0.004999958; 0; 0; -0.0009999997; 0; 0; 0.003599984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 0],
    Bpts=[0; 2615.1775; 3017.1775; 3419.1775; 3821.1775; 3825.1775; 3837.1775; 3849.1775; 3859.1775; 3909.1775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 24227.18],
    TblUnits="rad",
    BptUnits="m"),
  Gear=struct(Tbl=[1 1], Bpts=[0 1])), struct(
  Name="Bolt 61911005 Test Data_ACM_Testing_RAW.csv",
  VelRef=struct(
    Tbl=[1.5266103072e-5; 1.5266103072e-5; 1.5266103072e-5; 1.5266103072e-5; 1.5266103072e-5; 5.873837e-05; 2.926346e-05; 1.5266103072e-5; 1.5266103072e-5; 1.5266103072e-5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 0.00064700680352],
    Bpts=[0.099980831; 0.199980736; 0.29998064; 0.399980545; 0.49998045; 0.599980354; 0.699980259; 0.799980164; 0.899980068; 0.999979973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 867.9991531],
    TblUnits="m/s",
    BptUnits="s"),
  Grade=struct(
    UseTimeGradeBpts=0,
    Tbl=[0; 0; 0; 0.004999958; 0; 0; -0.0009999997; 0; 0; 0.003599984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 0],
    Bpts=[0; 2615.1775; 3017.1775; 3419.1775; 3821.1775; 3825.1775; 3837.1775; 3849.1775; 3859.1775; 3909.1775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 24227.18],
    TblUnits="rad",
    BptUnits="m"),
  Gear=struct(Tbl=[1 1], Bpts=[0 1])), struct(
  Name="Bolt 61911006 Test Data_ACM_Testing_RAW.csv",
  VelRef=struct(
    Tbl=[4.4245873408e-5; 2.15372696e-5; 1.5266103072e-5; 8.258214624e-5; 3.3959348896e-5; 0.00019405514656; 0.00018040835648; 4.666963e-05; 1.5266103072e-5; 1.5266103072e-5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 1.5266103072e-5],
    Bpts=[0.099980831; 0.199980736; 0.29998064; 0.399980545; 0.49998045; 0.599980354; 0.699980259; 0.799980164; 0.899980068; 0.999979973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 627.999382],
    TblUnits="m/s",
    BptUnits="s"),
  Grade=struct(
    UseTimeGradeBpts=0,
    Tbl=[0; 0; 0; 0.004999958; 0; 0; -0.0009999997; 0; 0; 0.003599984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 0],
    Bpts=[0; 2615.1775; 3017.1775; 3419.1775; 3821.1775; 3825.1775; 3837.1775; 3849.1775; 3859.1775; 3909.1775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 24227.18],
    TblUnits="rad",
    BptUnits="m"),
  Gear=struct(Tbl=[1 1], Bpts=[0 1])), struct(
  Name="Bolt 61911007 Test Data_ACM_Testing_RAW.csv",
  VelRef=struct(
    Tbl=[0.0007233710704; 0.00075552799872; 0.00065659178816; 0.0003963166064; 0.00035642633312; 0.00070013080192; 0.000683948848; 0.00065282100576; 0.00044787685888; 0.0005039732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 0.0005910517008],
    Bpts=[0.099980831; 0.199980736; 0.29998064; 0.399980545; 0.49998045; 0.599980354; 0.699980259; 0.799980164; 0.899980068; 0.999979973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 1822.998242],
    TblUnits="m/s",
    BptUnits="s"),
  Grade=struct(
    UseTimeGradeBpts=0,
    Tbl=[0; 0; 0; 0.004999958; 0; 0; -0.0009999997; 0; 0; 0.003599984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 0],
    Bpts=[0; 2615.1775; 3017.1775; 3419.1775; 3821.1775; 3825.1775; 3837.1775; 3849.1775; 3859.1775; 3909.1775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 24227.18],
    TblUnits="rad",
    BptUnits="m"),
  Gear=struct(Tbl=[1 1], Bpts=[0 1])), struct(
  Name="Bolt 61911008 Test Data_ACM_Testing_RAW.csv",
  VelRef=struct(
    Tbl=[0.04580919; 0.04583879; 0.03734139; 0.04349705; 0.04562415; 0.04587438; 0.04564661; 0.04585123; 0.04584987; 0.03724812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 0.00033404348736],
    Bpts=[0.099980831; 0.199980736; 0.29998064; 0.399980545; 0.49998045; 0.599980354; 0.699980259; 0.799980164; 0.899980068; 0.999979973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 1598.698456],
    TblUnits="m/s",
    BptUnits="s"),
  Grade=struct(
    UseTimeGradeBpts=0,
    Tbl=[0; 0; 0; 0.004999958; 0; 0; -0.0009999997; 0; 0; 0.003599984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 0],
    Bpts=[0; 2615.1775; 3017.1775; 3419.1775; 3821.1775; 3825.1775; 3837.1775; 3849.1775; 3859.1775; 3909.1775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 24227.18],
    TblUnits="rad",
    BptUnits="m"),
  Gear=struct(Tbl=[1 1], Bpts=[0 1])), struct(
  Name="Bolt 61911009 Test Data_ACM_Testing_RAW.csv",
  VelRef=struct(
    Tbl=[0.1217032; 0.4293229; 0.8596503; 1.29375; 1.678904; 2.042253; 2.420736; 2.810883; 3.205058; 3.586827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 0.0003630233024],
    Bpts=[0.099980831; 0.199980736; 0.29998064; 0.399980545; 0.49998045; 0.599980354; 0.699980259; 0.799980164; 0.899980068; 0.999979973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 833.3991861],
    TblUnits="m/s",
    BptUnits="s"),
  Grade=struct(
    UseTimeGradeBpts=0,
    Tbl=[0; 0; 0; 0.004999958; 0; 0; -0.0009999997; 0; 0; 0.003599984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 0],
    Bpts=[0; 2615.1775; 3017.1775; 3419.1775; 3821.1775; 3825.1775; 3837.1775; 3849.1775; 3859.1775; 3909.1775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 24227.18],
    TblUnits="rad",
    BptUnits="m"),
  Gear=struct(Tbl=[1 1], Bpts=[0 1])), struct(
  Name="Bolt_15-APP_Request_to_DBW_System_10ms.mat",
  VelRef=struct(
    Tbl=[0; 0; 0; 0; 0; 0; 0; 0; 0; 0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 10.27778],
    Bpts=[0; 0.01000003; 0.02000014; 0.03000017; 0.04000028; 0.05000031; 0.06000038; 0.0700005; 0.08000053; 0.09000064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 41.42026],
    TblUnits="m/s",
    BptUnits="s"),
  Grade=struct(
    UseTimeGradeBpts=0,
    Tbl=[0; 0; 0; 0.004999958; 0; 0; -0.0009999997; 0; 0; 0.003599984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 0],
    Bpts=[0; 2615.1775; 3017.1775; 3419.1775; 3821.1775; 3825.1775; 3837.1775; 3849.1775; 3859.1775; 3909.1775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 24227.18],
    TblUnits="rad",
    BptUnits="m"),
  Gear=struct(Tbl=[1 1], Bpts=[0 1])), struct(
  Name="Bolt_15-BPP_Request_to_DBW_System_10ms.mat",
  VelRef=struct(
    Tbl=[14.63542; 14.63542; 14.63542; 14.63542; 14.61806; 14.61806; 14.61806; 14.61806; 14.61806; 14.53993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 0.2170139],
    Bpts=[0; 0.01000008; 0.02000017; 0.03000025; 0.04000033; 0.05000042; 0.0600005; 0.07000059; 0.08000067; 0.09000075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 12.46009],
    TblUnits="m/s",
    BptUnits="s"),
  Grade=struct(
    UseTimeGradeBpts=0,
    Tbl=[0; 0; 0; 0.004999958; 0; 0; -0.0009999997; 0; 0; 0.003599984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 0],
    Bpts=[0; 2615.1775; 3017.1775; 3419.1775; 3821.1775; 3825.1775; 3837.1775; 3849.1775; 3859.1775; 3909.1775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 24227.18],
    TblUnits="rad",
    BptUnits="m"),
  Gear=struct(Tbl=[1 1], Bpts=[0 1])), struct(
  Name="Bolt_20-APP_Request_to_DBW_System_10ms.mat",
  VelRef=struct(
    Tbl=[0; 0; 0; 0; 0; 0; 0; 0; 0; 0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 16.15451],
    Bpts=[0; 0.0100001; 0.02000013; 0.03000023; 0.04000025; 0.05000035; 0.06000038; 0.07000048; 0.0800005; 0.09000061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 41.42027],
    TblUnits="m/s",
    BptUnits="s"),
  Grade=struct(
    UseTimeGradeBpts=0,
    Tbl=[0; 0; 0; 0.004999958; 0; 0; -0.0009999997; 0; 0; 0.003599984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 0],
    Bpts=[0; 2615.1775; 3017.1775; 3419.1775; 3821.1775; 3825.1775; 3837.1775; 3849.1775; 3859.1775; 3909.1775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 24227.18],
    TblUnits="rad",
    BptUnits="m"),
  Gear=struct(Tbl=[1 1], Bpts=[0 1])), struct(
  Name="Bolt_20-BPP_Request_to_DBW_System_10ms.mat",
  VelRef=struct(
    Tbl=[14.0625; 14.0625; 14.0625; 13.99306; 13.99306; 13.99306; 13.99306; 13.99306; 13.91493; 13.91493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 0.2777778],
    Bpts=[0; 0.01000008; 0.02000016; 0.03000028; 0.04000036; 0.05000044; 0.06000052; 0.0700006; 0.08000068; 0.09000076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 10.25007],
    TblUnits="m/s",
    BptUnits="s"),
  Grade=struct(
    UseTimeGradeBpts=0,
    Tbl=[0; 0; 0; 0.004999958; 0; 0; -0.0009999997; 0; 0; 0.003599984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 0],
    Bpts=[0; 2615.1775; 3017.1775; 3419.1775; 3821.1775; 3825.1775; 3837.1775; 3849.1775; 3859.1775; 3909.1775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 24227.18],
    TblUnits="rad",
    BptUnits="m"),
  Gear=struct(Tbl=[1 1], Bpts=[0 1])), struct(
  Name="Bolt_30-APP_Request_to_DBW_System_10ms.mat",
  VelRef=struct(
    Tbl=[0; 0; 0; 0; 0; 0; 0; 0; 0; 0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 26.15451],
    Bpts=[0; 0.01000005; 0.02000011; 0.03000016; 0.04000021; 0.0500003; 0.06000036; 0.07000041; 0.08000046; 0.09000051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 41.42023],
    TblUnits="m/s",
    BptUnits="s"),
  Grade=struct(
    UseTimeGradeBpts=0,
    Tbl=[0; 0; 0; 0.004999958; 0; 0; -0.0009999997; 0; 0; 0.003599984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 0],
    Bpts=[0; 2615.1775; 3017.1775; 3419.1775; 3821.1775; 3825.1775; 3837.1775; 3849.1775; 3859.1775; 3909.1775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 24227.18],
    TblUnits="rad",
    BptUnits="m"),
  Gear=struct(Tbl=[1 1], Bpts=[0 1])), struct(
  Name="Bolt_30-BPP_Request_to_DBW_System_10ms.mat",
  VelRef=struct(
    Tbl=[14.7309; 14.7309; 14.67014; 14.67014; 14.67014; 14.67014; 14.67014; 14.65278; 14.65278; 14.65278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 0],
    Bpts=[0; 0.01000007; 0.02000014; 0.03000021; 0.04000028; 0.05000035; 0.06000041; 0.07000048; 0.08000055; 0.09000062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 7.280054],
    TblUnits="m/s",
    BptUnits="s"),
  Grade=struct(
    UseTimeGradeBpts=0,
    Tbl=[0; 0; 0; 0.004999958; 0; 0; -0.0009999997; 0; 0; 0.003599984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 0],
    Bpts=[0; 2615.1775; 3017.1775; 3419.1775; 3821.1775; 3825.1775; 3837.1775; 3849.1775; 3859.1775; 3909.1775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 24227.18],
    TblUnits="rad",
    BptUnits="m"),
  Gear=struct(Tbl=[1 1], Bpts=[0 1])), struct(
  Name="Bolt_15-APP_Request_to_DBW_System_50ms.mat",
  VelRef=struct(
    Tbl=[0; 0; 0; 0; 0; 0; 0; 0; 0; 0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 10.68576],
    Bpts=[0; 0.05000031; 0.1000007; 0.1500011; 0.2000013; 0.2500017; 0.300002; 0.3500023; 0.4000027; 0.450003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 44.30028],
    TblUnits="m/s",
    BptUnits="s"),
  Grade=struct(
    UseTimeGradeBpts=0,
    Tbl=[0; 0; 0; 0.004999958; 0; 0; -0.0009999997; 0; 0; 0.003599984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 0],
    Bpts=[0; 2615.1775; 3017.1775; 3419.1775; 3821.1775; 3825.1775; 3837.1775; 3849.1775; 3859.1775; 3909.1775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 24227.18],
    TblUnits="rad",
    BptUnits="m"),
  Gear=struct(Tbl=[1 1], Bpts=[0 1])), struct(
  Name="Bolt_15-BPP_Request_to_DBW_System_50ms.mat",
  VelRef=struct(
    Tbl=[14.63542; 14.61806; 14.53993; 14.38368; 14.32292; 14.24479; 14.21875; 14.07118; 13.99306; 13.90625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 0.2170139],
    Bpts=[0; 0.05000042; 0.1000008; 0.1500012; 0.2000016; 0.2500021; 0.3000025; 0.3500029; 0.4000033; 0.4500037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 12.45009],
    TblUnits="m/s",
    BptUnits="s"),
  Grade=struct(
    UseTimeGradeBpts=0,
    Tbl=[0; 0; 0; 0.004999958; 0; 0; -0.0009999997; 0; 0; 0.003599984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 0],
    Bpts=[0; 2615.1775; 3017.1775; 3419.1775; 3821.1775; 3825.1775; 3837.1775; 3849.1775; 3859.1775; 3909.1775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 24227.18],
    TblUnits="rad",
    BptUnits="m"),
  Gear=struct(Tbl=[1 1], Bpts=[0 1])), struct(
  Name="Bolt_20-APP_Request_to_DBW_System_50ms.mat",
  VelRef=struct(
    Tbl=[0; 0; 0; 0; 0; 0; 0; 0; 0; 0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 14.46181],
    Bpts=[0; 0.05000035; 0.1000006; 0.150001; 0.2000013; 0.2500016; 0.3000019; 0.3500022; 0.4000026; 0.4500028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 34.55023],
    TblUnits="m/s",
    BptUnits="s"),
  Grade=struct(
    UseTimeGradeBpts=0,
    Tbl=[0; 0; 0; 0.004999958; 0; 0; -0.0009999997; 0; 0; 0.003599984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 0],
    Bpts=[0; 2615.1775; 3017.1775; 3419.1775; 3821.1775; 3825.1775; 3837.1775; 3849.1775; 3859.1775; 3909.1775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 24227.18],
    TblUnits="rad",
    BptUnits="m"),
  Gear=struct(Tbl=[1 1], Bpts=[0 1])), struct(
  Name="Bolt_20-BPP_Request_to_DBW_System_50ms.mat",
  VelRef=struct(
    Tbl=[14.0625; 13.99306; 13.91493; 13.71528; 13.68056; 13.49826; 13.40278; 13.26389; 13.15104; 13.02951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 0.2777778],
    Bpts=[0; 0.05000044; 0.1000008; 0.1500012; 0.2000016; 0.250002; 0.3000024; 0.3500028; 0.4000032; 0.4500036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 10.25007],
    TblUnits="m/s",
    BptUnits="s"),
  Grade=struct(
    UseTimeGradeBpts=0,
    Tbl=[0; 0; 0; 0.004999958; 0; 0; -0.0009999997; 0; 0; 0.003599984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 0],
    Bpts=[0; 2615.1775; 3017.1775; 3419.1775; 3821.1775; 3825.1775; 3837.1775; 3849.1775; 3859.1775; 3909.1775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 24227.18],
    TblUnits="rad",
    BptUnits="m"),
  Gear=struct(Tbl=[1 1], Bpts=[0 1])), struct(
  Name="Bolt_30-APP_Request_to_DBW_System_50ms.mat",
  VelRef=struct(
    Tbl=[0; 0; 0; 0; 0; 0; 0; 0; 0; 0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 26.04167],
    Bpts=[0; 0.0500003; 0.1000006; 0.1500008; 0.2000011; 0.2500013; 0.3000016; 0.3500019; 0.4000021; 0.4500024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 41.40023],
    TblUnits="m/s",
    BptUnits="s"),
  Grade=struct(
    UseTimeGradeBpts=0,
    Tbl=[0; 0; 0; 0.004999958; 0; 0; -0.0009999997; 0; 0; 0.003599984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 0],
    Bpts=[0; 2615.1775; 3017.1775; 3419.1775; 3821.1775; 3825.1775; 3837.1775; 3849.1775; 3859.1775; 3909.1775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 24227.18],
    TblUnits="rad",
    BptUnits="m"),
  Gear=struct(Tbl=[1 1], Bpts=[0 1])), struct(
  Name="Bolt_30-BPP_Request_to_DBW_System_50ms.mat",
  VelRef=struct(
    Tbl=[14.7309; 14.67014; 14.65278; 14.51389; 14.1059; 13.984375; 13.71528; 13.57639; 13.24653; 13.10764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 0],
    Bpts=[0; 0.05000035; 0.1000007; 0.1500011; 0.2000014; 0.2500017; 0.3000021; 0.3500024; 0.4000028; 0.4500032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 7.250054],
    TblUnits="m/s",
    BptUnits="s"),
  Grade=struct(
    UseTimeGradeBpts=0,
    Tbl=[0; 0; 0; 0.004999958; 0; 0; -0.0009999997; 0; 0; 0.003599984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 0],
    Bpts=[0; 2615.1775; 3017.1775; 3419.1775; 3821.1775; 3825.1775; 3837.1775; 3849.1775; 3859.1775; 3909.1775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 24227.18],
    TblUnits="rad",
    BptUnits="m"),
  Gear=struct(Tbl=[1 1], Bpts=[0 1])), struct(
  Name="Bolt_10-BPP_Request_to_DBW_System_50ms.mat",
  VelRef=struct(
    Tbl=[14.59201; 14.609375; 14.51389; 14.46181; 14.43576; 14.34028; 14.296875; 14.24479; 14.14931; 14.14931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 0.4513889],
    Bpts=[0; 0.0500003; 0.1000006; 0.1500009; 0.2000012; 0.2500015; 0.3000018; 0.3500021; 0.4000024; 0.4500027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 34.65025],
    TblUnits="m/s",
    BptUnits="s"),
  Grade=struct(
    UseTimeGradeBpts=0,
    Tbl=[0; 0; 0; 0.004999958; 0; 0; -0.0009999997; 0; 0; 0.003599984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 0],
    Bpts=[0; 2615.1775; 3017.1775; 3419.1775; 3821.1775; 3825.1775; 3837.1775; 3849.1775; 3859.1775; 3909.1775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 24227.18],
    TblUnits="rad",
    BptUnits="m"),
  Gear=struct(Tbl=[1 1], Bpts=[0 1])), struct(
  Name="Bolt_2.5-BPP_Request_to_DBW_System_50ms.mat",
  VelRef=struct(
    Tbl=[14.921875; 14.85243; 14.86979; 14.84375; 14.765625; 14.77431; 14.71354; 14.65278; 14.63542; 14.59201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 1.258681],
    Bpts=[0; 0.05000045; 0.1000009; 0.1500013; 0.2000018; 0.2500023; 0.3000027; 0.3500032; 0.4000036; 0.4500041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 45.15033],
    TblUnits="m/s",
    BptUnits="s"),
  Grade=struct(
    UseTimeGradeBpts=0,
    Tbl=[0; 0; 0; 0.004999958; 0; 0; -0.0009999997; 0; 0; 0.003599984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 0],
    Bpts=[0; 2615.1775; 3017.1775; 3419.1775; 3821.1775; 3825.1775; 3837.1775; 3849.1775; 3859.1775; 3909.1775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 24227.18],
    TblUnits="rad",
    BptUnits="m"),
  Gear=struct(Tbl=[1 1], Bpts=[0 1])), struct(
  Name="Bolt_5-BPP_Request_to_DBW_System_50ms.mat",
  VelRef=struct(
    Tbl=[14.94792; 14.93056; 14.88715; 14.86979; 14.80903; 14.77431; 14.74826; 14.71354; 14.65278; 14.65278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 1.09375],
    Bpts=[0; 0.05000039; 0.1000007; 0.1500011; 0.2000014; 0.2500017; 0.3000021; 0.3500025; 0.4000028; 0.4500031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 46.95034],
    TblUnits="m/s",
    BptUnits="s"),
  Grade=struct(
    UseTimeGradeBpts=0,
    Tbl=[0; 0; 0; 0.004999958; 0; 0; -0.0009999997; 0; 0; 0.003599984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 0],
    Bpts=[0; 2615.1775; 3017.1775; 3419.1775; 3821.1775; 3825.1775; 3837.1775; 3849.1775; 3859.1775; 3909.1775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 24227.18],
    TblUnits="rad",
    BptUnits="m"),
  Gear=struct(Tbl=[1 1], Bpts=[0 1])), struct(
  Name="Bolt_7.5-BPP_Request_to_DBW_System_50ms.mat",
  VelRef=struct(
    Tbl=[14.14931; 14.140625; 14.01042; 14.07118; 14.02778; 13.94965; 13.93229; 13.87153; 13.828125; 13.828125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 0.6857639],
    Bpts=[0; 0.05000035; 0.1000006; 0.150001; 0.2000013; 0.2500015; 0.3000019; 0.3500022; 0.4000025; 0.4500028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 47.25034],
    TblUnits="m/s",
    BptUnits="s"),
  Grade=struct(
    UseTimeGradeBpts=0,
    Tbl=[0; 0; 0; 0.004999958; 0; 0; -0.0009999997; 0; 0; 0.003599984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 0],
    Bpts=[0; 2615.1775; 3017.1775; 3419.1775; 3821.1775; 3825.1775; 3837.1775; 3849.1775; 3859.1775; 3909.1775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 24227.18],
    TblUnits="rad",
    BptUnits="m"),
  Gear=struct(Tbl=[1 1], Bpts=[0 1]))]

TestScnrioCycleNum = 2
Ref_speed = [12.97456 12.97439 12.97428 12.97423 12.97423 12.97429 12.97441 12.97458 12.97481 12.97509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 15]
Ref_time = [0 0.01 0.02 0.03 0.04 0.05 0.06 0.07 0.08 0.09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 20.16]