test file "PassengerEvTests"

suite "Component Tests"

  suite "Wheel and Tire Tests"

    case "Rear Wheel Set Step Axle Torque and Braking" [simulation]
      description: 1. Test set of wheels connected to differential.
      model mDiffWheelSet
      assessment "Check Energy Diff": At any point of time, EnrgyDiff must be greater than -0.001
        EnrgyDiff: signal mDiffWheelSet/Integrator, port 1
      iteration script:
        %% Iterate over all Configuration Sets.
         sltest_configSets = {'ConfigSetDesktopFixedStep', 'ConfigSetVariableStep'};
        % Determine the number of possible iterations
        numSteps = length(sltest_configSets);

        % Create each iteration
        for k = 1 : numSteps
            % Set up a new iteration object
            testItr = sltestiteration();

            % Set iteration settings
            setTestParam(testItr, 'ConfigSet', sltest_configSets{k});

            % Register the iteration to run in this test case
            addIteration(sltest_testCase, testItr, sltest_configSets{k}); % You can pass in an optional iteration name
        end

suite "System Tests"

  case "0-60-0" [simulation]
    model EvPassengerModel, stop time 600
    post-load callback:
      MdlConfigs = getMdlConfigs;
      ConfigObj = MdlConfigs.findByName('0-60-0');
      ConfigObj.activateVariant;

  case "Drive Cycles" [baseline]
    model EvPassengerModel, stop time 1000
    post-load callback:
      MdlConfigs = getMdlConfigs;
      ConfigObj = MdlConfigs.findByName('Drive Cycles');
      ConfigObj.Configs(1).activateVariant;
    assessment "CompareVehSpd" (off): At any point of time, VehSpd must be greater than VehRefSpd-.1 and less than VehRefSpd+.1
      VehRefSpd: signal Class8TruckModel/Test Scenario/Drive Cycle Source/Drive Cycle Source, port 1
      VehSpd: signal Class8TruckModel/Monitor/Bus Selector, port 1
    iteration script:
      %% Iterate over all Parameter Sets.
      DdDriveCycleName = 'DdDriveCycleSrc.sldd';
      DdDriveCycle = Simulink.data.dictionary.open(DdDriveCycleName);
      DdSection = DdDriveCycle.getSection('Design Data');
      DriveCycleStruct = DdSection.evalin('TestScnrioDriveCycleStructs');
      CycleNames = {DriveCycleStruct.Name};
      DdDriveCycle.close

      % Determine the number of possible iterations
      numSteps = length(CycleNames);

      % Create each iteration
      for k = 1 : numSteps
          % Set up a new iteration object
          testItr = sltestiteration();
          testItr.Name = CycleNames{k};

          % Set iteration settings
          testItr.setVariable('Name', 'TestScnrioCycleNum', 'Source', DdDriveCycleName, 'Value', k)

          % Register the iteration to run in this test case
          addIteration(sltest_testCase, testItr); % You can pass in an optional iteration name
      end