% Simulink data dictionary DdDriveCycleTest.sldd

PtbsDriveCycleStructArray = [struct(
  Name="Allgemeiner Deutscher Automobil-Club Highway Cycle BAB 130",
  VelRef=struct(
    Tbl=[0; 0; 0; 0; 0; 0; 0; 0; 0; 0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 0],
    Bpts=[0; 1; 2; 3; 4; 5; 6; 7; 8; 9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 795],
    TblUnits="m/s",
    BptUnits="seconds"),
  Grade=struct(UseTimeGradeBpts=1, Tbl=[0 0], Bpts=[0 1], TblUnits="rad", BptUnits="s"),
  Gear=struct(
    Tbl=[0; 0; 0; 0; 0; 0; 0; 1; 1; 1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 0],
    Bpts=[0; 1; 2; 3; 4; 5; 6; 7; 8; 9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 795])), struct(
  Name="Artemis Motorway 130 km/h",
  VelRef=struct(
    Tbl=[0; 0; 0; 0; 0; 0; 0; 0.6666667; 0.8055556; 1.472222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 0],
    Bpts=[0; 1; 2; 3; 4; 5; 6; 7; 8; 9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 1068],
    TblUnits="m/s",
    BptUnits="seconds"),
  Grade=struct(UseTimeGradeBpts=1, Tbl=[0 0], Bpts=[0 1], TblUnits="rad", BptUnits="s"),
  Gear=struct(Tbl=[1 1])), struct(
  Name="Artemis Motorway 150 km/h",
  VelRef=struct(
    Tbl=[0; 0; 0; 0; 0; 0; 0; 0.6666667; 0.8055556; 1.472222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 0],
    Bpts=[0; 1; 2; 3; 4; 5; 6; 7; 8; 9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 1068],
    TblUnits="m/s",
    BptUnits="seconds"),
  Grade=struct(UseTimeGradeBpts=1, Tbl=[0 0], Bpts=[0 1], TblUnits="rad", BptUnits="s"),
  Gear=struct(Tbl=[1 1])), struct(
  Name="Artemis Rural Road",
  VelRef=struct(
    Tbl=[0; 0; 0; 0; 0; 0; 0.5555556; 2.611111; 4.527778; 5.472222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 0],
    Bpts=[0; 1; 2; 3; 4; 5; 6; 7; 8; 9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 1082],
    TblUnits="m/s",
    BptUnits="seconds"),
  Grade=struct(UseTimeGradeBpts=1, Tbl=[0 0], Bpts=[0 1], TblUnits="rad", BptUnits="s"),
  Gear=struct(Tbl=[1 1])), struct(
  Name="Artemis Urban",
  VelRef=struct(
    Tbl=[0; 0; 0; 0; 0; 0; 0; 0; 0; 0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 0],
    Bpts=[0; 1; 2; 3; 4; 5; 6; 7; 8; 9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 993],
    TblUnits="m/s",
    BptUnits="seconds"),
  Grade=struct(UseTimeGradeBpts=1, Tbl=[0 0], Bpts=[0 1], TblUnits="rad", BptUnits="s"),
  Gear=struct(Tbl=[1 1])), struct(
  Name="Business Arterial Commuter (BAC) - Arterial Cycle (SAE J1376)",
  VelRef=struct(
    Tbl=[0; 0.89408; 1.78816; 2.637536; 3.486912; 4.336288; 5.14096; 5.945632; 6.750304; 7.510272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 0],
    Bpts=[0; 1; 2; 3; 4; 5; 6; 7; 8; 9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 270],
    TblUnits="m/s",
    BptUnits="seconds"),
  Grade=struct(UseTimeGradeBpts=1, Tbl=[0 0], Bpts=[0 1], TblUnits="rad", BptUnits="s"),
  Gear=struct(Tbl=[1 1])), struct(
  Name="Business Arterial Commuter (BAC) - Commuter Cycle (SAE J1376)",
  VelRef=struct(
    Tbl=[0; 0.983488; 1.922272; 2.861056; 3.755136; 4.604512; 5.409184; 6.213856; 6.973824; 7.689088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 0],
    Bpts=[0; 1; 2; 3; 4; 5; 6; 7; 8; 9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 310],
    TblUnits="m/s",
    BptUnits="seconds"),
  Grade=struct(UseTimeGradeBpts=1, Tbl=[0 0], Bpts=[0 1], TblUnits="rad", BptUnits="s"),
  Gear=struct(Tbl=[1 1])), struct(
  Name="Braunschweig City Driving Cycle",
  VelRef=struct(
    Tbl=[0; 0; 0; 0; 0; 0; 0; 0; 0; 0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 0],
    Bpts=[1; 2; 3; 4; 5; 6; 7; 8; 9; 10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 1740],
    TblUnits="m/s",
    BptUnits="seconds"),
  Grade=struct(UseTimeGradeBpts=1, Tbl=[0 0], Bpts=[0 1], TblUnits="rad", BptUnits="s"),
  Gear=struct(Tbl=[1 1])), struct(
  Name="Central Business District (CBD) SAE J1376",
  VelRef=struct(
    Tbl=[0; 0.89408; 1.78816; 2.68224; 3.57632; 4.4704; 5.36448; 6.25856; 7.15264; 8.04672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 0],
    Bpts=[0; 1; 2; 3; 4; 5; 6; 7; 8; 9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 560],
    TblUnits="m/s",
    BptUnits="seconds"),
  Grade=struct(UseTimeGradeBpts=1, Tbl=[0 0], Bpts=[0 1], TblUnits="rad", BptUnits="s"),
  Gear=struct(Tbl=[1 1])), struct(
  Name="City Suburban Heavy Vehicle Cycle (CSC)",
  VelRef=struct(
    Tbl=[0; 0; 0; 0; 0; 0; 0; 0; 0; 0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 0],
    Bpts=[1; 2; 3; 4; 5; 6; 7; 8; 9; 10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 1700],
    TblUnits="m/s",
    BptUnits="seconds"),
  Grade=struct(UseTimeGradeBpts=1, Tbl=[0 0], Bpts=[0 1], TblUnits="rad", BptUnits="s"),
  Gear=struct(Tbl=[1 1])), struct(
  Name="Composite Urban Emissions Drive Cycle (CUEDC) diesel cycle - MC vehicle category (October 2000)",
  VelRef=struct(
    Tbl=[0; 0; 0; 0; 0; 0; 0; 0; 0; 0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 0],
    Bpts=[0; 1; 2; 3; 4; 5; 6; 7; 8; 9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 1723],
    TblUnits="m/s",
    BptUnits="seconds"),
  Grade=struct(UseTimeGradeBpts=1, Tbl=[0 0], Bpts=[0 1], TblUnits="rad", BptUnits="s"),
  Gear=struct(
    Tbl=[0; 0; 0; 0; 0; 0; 0; 0; 0; 0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 0],
    Bpts=[0; 1; 2; 3; 4; 5; 6; 7; 8; 9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 1723])), struct(
  Name="Composite Urban Emissions Drive Cycle (CUEDC) diesel cycle - ME vehicle category (October 2000)",
  VelRef=struct(
    Tbl=[0; 0; 0; 0; 0; 0; 0; 0; 0; 0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 0],
    Bpts=[0; 1; 2; 3; 4; 5; 6; 7; 8; 9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 1678],
    TblUnits="m/s",
    BptUnits="seconds"),
  Grade=struct(UseTimeGradeBpts=1, Tbl=[0 0], Bpts=[0 1], TblUnits="rad", BptUnits="s"),
  Gear=struct(
    Tbl=[0; 0; 0; 0; 0; 0; 0; 0; 0; 0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 0],
    Bpts=[0; 1; 2; 3; 4; 5; 6; 7; 8; 9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 1678])), struct(
  Name="Composite Urban Emissions Drive Cycle (CUEDC) diesel cycle - NA vehicle category (October 2000)",
  VelRef=struct(
    Tbl=[0; 0; 0; 0; 0; 0; 0; 0; 0; 0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 0],
    Bpts=[0; 1; 2; 3; 4; 5; 6; 7; 8; 9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 1795],
    TblUnits="m/s",
    BptUnits="seconds"),
  Grade=struct(UseTimeGradeBpts=1, Tbl=[0 0], Bpts=[0 1], TblUnits="rad", BptUnits="s"),
  Gear=struct(
    Tbl=[0; 0; 0; 0; 0; 0; 0; 0; 0; 0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 0],
    Bpts=[0; 1; 2; 3; 4; 5; 6; 7; 8; 9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 1795])), struct(
  Name="Composite Urban Emissions Drive Cycle (CUEDC) diesel cycle - NB vehicle category (October 2000)",
  VelRef=struct(
    Tbl=[0; 0; 0; 0; 0; 0; 0; 0; 0; 0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 0],
    Bpts=[0; 1; 2; 3; 4; 5; 6; 7; 8; 9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 1706],
    TblUnits="m/s",
    BptUnits="seconds"),
  Grade=struct(UseTimeGradeBpts=1, Tbl=[0 0], Bpts=[0 1], TblUnits="rad", BptUnits="s"),
  Gear=struct(
    Tbl=[0; 0; 0; 0; 0; 0; 0; 0; 0; 0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 0],
    Bpts=[0; 1; 2; 3; 4; 5; 6; 7; 8; 9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 1706])), struct(
  Name="Composite Urban Emissions Drive Cycle (CUEDC) diesel cycle - NC vehicle category (October 2000)",
  VelRef=struct(
    Tbl=[0; 0; 0.001111111; 0.02138889; 0.09027778; 1.066944; 1.790833; 2.177778; 2.645; 4.594444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 0],
    Bpts=[0; 1; 2; 3; 4; 5; 6; 7; 8; 9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 1797],
    TblUnits="m/s",
    BptUnits="seconds"),
  Grade=struct(UseTimeGradeBpts=1, Tbl=[0 0], Bpts=[0 1], TblUnits="rad", BptUnits="s"),
  Gear=struct(
    Tbl=[0; 0; 0; 0; 0; 0; 0; 0; 0; 0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 0],
    Bpts=[0; 1; 2; 3; 4; 5; 6; 7; 8; 9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 1797])), struct(
  Name="Composite Urban Emissions Drive Cycle (CUEDC) diesel cycle - NCH vehicle category (October 2000)",
  VelRef=struct(
    Tbl=[0; 0; 0; 0; 0; 0; 0; 0; 0; 0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 0],
    Bpts=[0; 1; 2; 3; 4; 5; 6; 7; 8; 9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 1676],
    TblUnits="m/s",
    BptUnits="seconds"),
  Grade=struct(UseTimeGradeBpts=1, Tbl=[0 0], Bpts=[0 1], TblUnits="rad", BptUnits="s"),
  Gear=struct(
    Tbl=[0; 0; 0; 0; 0; 0; 0; 0; 0; 0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 0],
    Bpts=[0; 1; 2; 3; 4; 5; 6; 7; 8; 9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 1676])), struct(
  Name="Composite Urban Emissions Drive Cycle (CUEDC) petrol cycle (NISE2, March 2009)",
  VelRef=struct(
    Tbl=[0; 0; 0; 0; 0; 0; 0; 0; 0; 0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 0],
    Bpts=[2; 3; 4; 5; 6; 7; 8; 9; 10; 11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 499],
    TblUnits="m/s",
    BptUnits="seconds"),
  Grade=struct(UseTimeGradeBpts=1, Tbl=[0 0], Bpts=[0 1], TblUnits="rad", BptUnits="s"),
  Gear=struct(Tbl=[1 1])), struct(
  Name="Composite Urban Emissions Drive Cycle (CUEDC) short petrol SPC240 cycle (NISE2, March 2009)",
  VelRef=struct(
    Tbl=[0; 0; 0; 0; 0; 0; 0; 0; 0; 0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 0],
    Bpts=[1; 2; 3; 4; 5; 6; 7; 8; 9; 10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 240],
    TblUnits="m/s",
    BptUnits="seconds"),
  Grade=struct(UseTimeGradeBpts=1, Tbl=[0 0], Bpts=[0 1], TblUnits="rad", BptUnits="s"),
  Gear=struct(Tbl=[1 1])), struct(
  Name="UN/ECE Elementary Urban ECE R15 Type 1 -  Single Cycle",
  VelRef=struct(
    Tbl=[0; 0; 0; 0; 0; 0; 0; 0; 0; 0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 0],
    Bpts=[0; 1; 2; 3; 4; 5; 6; 7; 8; 9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 195],
    TblUnits="m/s",
    BptUnits="seconds"),
  Grade=struct(UseTimeGradeBpts=1, Tbl=[0 0], Bpts=[0 1], TblUnits="rad", BptUnits="s"),
  Gear=struct(
    Tbl=[0; 0; 0; 0; 0; 0; 0; 0; 0; 0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 0],
    Bpts=[0; 1; 2; 3; 4; 5; 6; 7; 8; 9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 195])), struct(
  Name="ECE15 + EUDC aka MVEG-A",
  VelRef=struct(
    Tbl=[0; 0; 0; 0; 0; 0; 0; 0; 0; 0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 0],
    Bpts=[0; 1; 2; 3; 4; 5; 6; 7; 8; 9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 1220],
    TblUnits="m/s",
    BptUnits="seconds"),
  Grade=struct(UseTimeGradeBpts=1, Tbl=[0 0], Bpts=[0 1], TblUnits="rad", BptUnits="s"),
  Gear=struct(
    Tbl=[0; 0; 0; 0; 0; 0; 0; 0; 0; 0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 0],
    Bpts=[0; 1; 2; 3; 4; 5; 6; 7; 8; 9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 1220])), struct(
  Name="Urban Driving Cycle ECE R15 - Full",
  VelRef=struct(
    Tbl=[0; 0; 0; 0; 0; 0; 0; 0; 0; 0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 0],
    Bpts=[0; 1; 2; 3; 4; 5; 6; 7; 8; 9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 780],
    TblUnits="m/s",
    BptUnits="seconds"),
  Grade=struct(UseTimeGradeBpts=1, Tbl=[0 0], Bpts=[0 1], TblUnits="rad", BptUnits="s"),
  Gear=struct(
    Tbl=[0; 0; 0; 0; 0; 0; 0; 0; 0; 0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 0],
    Bpts=[0; 1; 2; 3; 4; 5; 6; 7; 8; 9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 780])), struct(
  Name="UN/ECE Extra-Urban Driving Cycle (Low Powered Vehicles) is an alternative for Low-Powered Vehicles for Part 2 of the ECE Type 1 Test",
  VelRef=struct(
    Tbl=[0; 0; 0; 0; 0; 0; 0; 0; 0; 0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 0],
    Bpts=[1; 2; 3; 4; 5; 6; 7; 8; 9; 10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 400],
    TblUnits="m/s",
    BptUnits="seconds"),
  Grade=struct(UseTimeGradeBpts=1, Tbl=[0 0], Bpts=[0 1], TblUnits="rad", BptUnits="s"),
  Gear=struct(
    Tbl=[0; 0; 0; 0; 0; 0; 0; 0; 0; 0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 0],
    Bpts=[0; 1; 2; 3; 4; 5; 6; 7; 8; 9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 400])), struct(
  Name="ETC FIGE Version 4 cycle",
  VelRef=struct(
    Tbl=[0.1111111; 0.1111111; 0.1111111; 0.1111111; 0.1111111; 0.1111111; 0.1111111; 0.1111111; 0.1111111; 0.08333333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 0.1111111],
    Bpts=[1; 2; 3; 4; 5; 6; 7; 8; 9; 10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 1800],
    TblUnits="m/s",
    BptUnits="seconds"),
  Grade=struct(UseTimeGradeBpts=1, Tbl=[0 0], Bpts=[0 1], TblUnits="rad", BptUnits="s"),
  Gear=struct(Tbl=[1 1])), struct(
  Name="UN/ECE Extra-Urban Driving Cycle is Part 2 of the ECE Type 1 Test",
  VelRef=struct(
    Tbl=[0; 0; 0; 0; 0; 0; 0; 0; 0; 0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 0],
    Bpts=[0; 1; 2; 3; 4; 5; 6; 7; 8; 9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 400],
    TblUnits="m/s",
    BptUnits="seconds"),
  Grade=struct(UseTimeGradeBpts=1, Tbl=[0 0], Bpts=[0 1], TblUnits="rad", BptUnits="s"),
  Gear=struct(
    Tbl=[0; 0; 0; 0; 0; 0; 0; 0; 0; 0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 0],
    Bpts=[0; 1; 2; 3; 4; 5; 6; 7; 8; 9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 400])), struct(
  Name="US EPA Urban Dynamometer Driving Schedule (FTP-72)",
  VelRef=struct(
    Tbl=[0; 0; 0; 0; 0; 0; 0; 0; 0; 0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 0],
    Bpts=[1; 2; 3; 4; 5; 6; 7; 8; 9; 10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 1372],
    TblUnits="m/s",
    BptUnits="seconds"),
  Grade=struct(UseTimeGradeBpts=1, Tbl=[0 0], Bpts=[0 1], TblUnits="rad", BptUnits="s"),
  Gear=struct(Tbl=[1 1])), struct(
  Name="FTP75",
  VelRef=struct(
    Tbl=[0; 0; 0; 0; 0; 0; 0; 0; 0; 0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 0],
    Bpts=[1; 2; 3; 4; 5; 6; 7; 8; 9; 10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 2474],
    TblUnits="m/s",
    BptUnits="seconds"),
  Grade=struct(UseTimeGradeBpts=1, Tbl=[0 0], Bpts=[0 1], TblUnits="rad", BptUnits="s"),
  Gear=struct(Tbl=[1 1])), struct(
  Name="Heavy Heavy-Duty Diesel Truck (HHDDT) - Creep Mode",
  VelRef=struct(
    Tbl=[0; 0; 0; 0; 0; 0; 0; 0; 0; 0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 0],
    Bpts=[1; 2; 3; 4; 5; 6; 7; 8; 9; 10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 253],
    TblUnits="m/s",
    BptUnits="seconds"),
  Grade=struct(UseTimeGradeBpts=1, Tbl=[0 0], Bpts=[0 1], TblUnits="rad", BptUnits="s"),
  Gear=struct(Tbl=[1 1])), struct(
  Name="Heavy Heavy-Duty Diesel Truck (HHDDT) - Cruise Mode",
  VelRef=struct(
    Tbl=[0; 0; 0; 0; 0; 0; 0; 0; 0; 0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 0],
    Bpts=[1; 2; 3; 4; 5; 6; 7; 8; 9; 10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 2083],
    TblUnits="m/s",
    BptUnits="seconds"),
  Grade=struct(UseTimeGradeBpts=1, Tbl=[0 0], Bpts=[0 1], TblUnits="rad", BptUnits="s"),
  Gear=struct(Tbl=[1 1])), struct(
  Name="Heavy Heavy-Duty Diesel Truck (HHDDT) - Transient Mode",
  VelRef=struct(
    Tbl=[0; 0; 0; 0; 0; 0; 0.0983488; 0.3710432; 0.7912608; 1.2338304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 0],
    Bpts=[1; 2; 3; 4; 5; 6; 7; 8; 9; 10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 668],
    TblUnits="m/s",
    BptUnits="seconds"),
  Grade=struct(UseTimeGradeBpts=1, Tbl=[0 0], Bpts=[0 1], TblUnits="rad", BptUnits="s"),
  Gear=struct(Tbl=[1 1])), struct(
  Name="EPA Heavy Urban Dynamometer Driving Schedule",
  VelRef=struct(
    Tbl=[0; 0; 0; 0; 0; 0; 0; 0; 0; 0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 0],
    Bpts=[0; 1; 2; 3; 4; 5; 6; 7; 8; 9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 1060],
    TblUnits="m/s",
    BptUnits="seconds"),
  Grade=struct(UseTimeGradeBpts=1, Tbl=[0 0], Bpts=[0 1], TblUnits="rad", BptUnits="s"),
  Gear=struct(Tbl=[1 1])), struct(
  Name="Highway Fuel Economy Driving Schedule (HWFET)",
  VelRef=struct(
    Tbl=[0; 0; 0; 0.8940778; 2.190491; 3.621015; 5.051539; 6.482064; 7.733773; 8.761962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 0],
    Bpts=[0; 1; 2; 3; 4; 5; 6; 7; 8; 9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 765],
    TblUnits="m/s",
    BptUnits="seconds"),
  Grade=struct(UseTimeGradeBpts=1, Tbl=[0 0], Bpts=[0 1], TblUnits="rad", BptUnits="s"),
  Gear=struct(Tbl=[1 1])), struct(
  Name="IM240 Inspection & Maintenance Driving Schedule",
  VelRef=struct(
    Tbl=[0; 0; 0; 0; 0; 1.341117; 2.637529; 3.844534; 5.140947; 6.392656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 0],
    Bpts=[0; 1; 2; 3; 4; 5; 6; 7; 8; 9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 240],
    TblUnits="m/s",
    BptUnits="seconds"),
  Grade=struct(UseTimeGradeBpts=1, Tbl=[0 0], Bpts=[0 1], TblUnits="rad", BptUnits="s"),
  Gear=struct(Tbl=[1 1])), struct(
  Name="Japanese chassis dynamometer test cycle for light-duty vehicles (cold)",
  VelRef=struct(
    Tbl=[0; 0; 0; 0; 0; 0; 0; 0; 0; 0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 0],
    Bpts=[0; 1; 2; 3; 4; 5; 6; 7; 8; 9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 1204],
    TblUnits="m/s",
    BptUnits="seconds"),
  Grade=struct(UseTimeGradeBpts=1, Tbl=[0 0], Bpts=[0 1], TblUnits="rad", BptUnits="s"),
  Gear=struct(
    Tbl=[0 0 0
     0 0 0
     0 0 0
     0 0 0
     0 0 0
     0 0 0
     0 0 0
     0 0 0
     0 0 0
     0 0 0
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     ],
    Bpts=[0; 1; 2; 3; 4; 5; 6; 7; 8; 9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 1204])), struct(
  Name="Japanese chassis dynamometer test cycle for light-duty vehicles",
  VelRef=struct(
    Tbl=[0; 0; 0; 0; 0; 0; 0; 0; 0; 0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 0],
    Bpts=[0; 1; 2; 3; 4; 5; 6; 7; 8; 9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 1376],
    TblUnits="m/s",
    BptUnits="seconds"),
  Grade=struct(UseTimeGradeBpts=1, Tbl=[0 0], Bpts=[0 1], TblUnits="rad", BptUnits="s"),
  Gear=struct(
    Tbl=[2 0 0 0
     2 0 0 0
     2 0 0 0
     2 0 0 0
     2 0 0 0
     2 0 0 0
     2 0 0 0
     2 0 0 0
     2 0 0 0
     2 1 1 1
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     ],
    Bpts=[0; 1; 2; 3; 4; 5; 6; 7; 8; 9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 1376])), struct(
  Name="Japanese Transient Mode for vehicles > 3500 kg GVW",
  VelRef=struct(
    Tbl=[0; 0; 0; 0; 0; 0; 0; 0; 0; 0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 0],
    Bpts=[0; 1; 2; 3; 4; 5; 6; 7; 8; 9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 1829],
    TblUnits="m/s",
    BptUnits="seconds"),
  Grade=struct(UseTimeGradeBpts=1, Tbl=[0 0], Bpts=[0 1], TblUnits="rad", BptUnits="s"),
  Gear=struct(
    Tbl=[0; 0; 0; 0; 0; 0; 0; 0; 0; 0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 0],
    Bpts=[0; 1; 2; 3; 4; 5; 6; 7; 8; 9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 1829])), struct(
  Name="Japanese 10 Dynamometer Driving Schedule",
  VelRef=struct(
    Tbl=[0; 0; 0; 0; 0; 0; 0; 0; 0; 0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 0],
    Bpts=[0; 1; 2; 3; 4; 5; 6; 7; 8; 9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 135],
    TblUnits="m/s",
    BptUnits="seconds"),
  Grade=struct(UseTimeGradeBpts=1, Tbl=[0 0], Bpts=[0 1], TblUnits="rad", BptUnits="s"),
  Gear=struct(Tbl=[1 1])), struct(
  Name="Japanese 10.15 Mode Driving Schedule for Exhaust Measurement and Fuel Economy Test Procedures",
  VelRef=struct(
    Tbl=[0; 0; 0; 0; 0; 0; 0; 0; 0; 0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 0],
    Bpts=[1; 2; 3; 4; 5; 6; 7; 8; 9; 10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 660],
    TblUnits="m/s",
    BptUnits="seconds"),
  Grade=struct(UseTimeGradeBpts=1, Tbl=[0 0], Bpts=[0 1], TblUnits="rad", BptUnits="s"),
  Gear=struct(Tbl=[1 1])), struct(
  Name="Japanese15 Dynamometer Driving Schedule",
  VelRef=struct(
    Tbl=[0; 0; 0; 0; 0; 0; 0; 0; 0; 0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 0],
    Bpts=[0; 1; 2; 3; 4; 5; 6; 7; 8; 9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 231],
    TblUnits="m/s",
    BptUnits="seconds"),
  Grade=struct(UseTimeGradeBpts=1, Tbl=[0 0], Bpts=[0 1], TblUnits="rad", BptUnits="s"),
  Gear=struct(Tbl=[1 1])), struct(
  Name="Air Resources Board LA92 Dynamometer Driving Schedule",
  VelRef=struct(
    Tbl=[0; 0; 0; 0; 0; 0; 0; 0; 0; 0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 0],
    Bpts=[0; 1; 2; 3; 4; 5; 6; 7; 8; 9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 1435],
    TblUnits="m/s",
    BptUnits="seconds"),
  Grade=struct(UseTimeGradeBpts=1, Tbl=[0 0], Bpts=[0 1], TblUnits="rad", BptUnits="s"),
  Gear=struct(Tbl=[1 1])), struct(
  Name="Air Resources Board LA92 Dynamometer Driving Schedule - Short",
  VelRef=struct(
    Tbl=[0; 0; 0; 0; 0; 0; 0; 0; 0; 0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 0],
    Bpts=[0; 1; 2; 3; 4; 5; 6; 7; 8; 9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 969],
    TblUnits="m/s",
    BptUnits="seconds"),
  Grade=struct(UseTimeGradeBpts=1, Tbl=[0 0], Bpts=[0 1], TblUnits="rad", BptUnits="s"),
  Gear=struct(Tbl=[1 1]))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]

VsrDriveCycleStructArray = [struct(
  Name="CARB_HHDDT_Transient",
  VelRef=struct(
    Tbl=[0; 0; 0; 0; 0; 0; 0.1833; 0.5275; 1.0103; 1.4261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 0],
    Bpts=[1; 2; 3; 4; 5; 6; 7; 8; 9; 10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 668],
    TblUnits="m/s",
    BptUnits="s"),
  Grade=struct(UseTimeGradeBpts=0, Tbl=[0; 0], Bpts=[0; 4573.707], TblUnits="rad", BptUnits="m"),
  Gear=struct(Tbl=[1 1], Bpts=[0 1])), struct(
  Name="UNECE_WHVC",
  VelRef=struct(
    Tbl=[0; 0; 0; 0; 0; 0; 0.6527778; 1.547222; 2.272222; 2.602778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 0],
    Bpts=[1; 2; 3; 4; 5; 6; 7; 8; 9; 10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 1800],
    TblUnits="m/s",
    BptUnits="s"),
  Grade=struct(UseTimeGradeBpts=0, Tbl=[0; 0], Bpts=[0; 20072.07], TblUnits="rad", BptUnits="m"),
  Gear=struct(Tbl=[1 1], Bpts=[0 1])), struct(
  Name="HTUF_Class6_Parcel",
  VelRef=struct(
    Tbl=[0; 0; 0; 0; 0; 0; 0; 0; 0; 0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 0],
    Bpts=[0; 1; 2; 3; 4; 5; 6; 7; 8; 9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 3906],
    TblUnits="m/s",
    BptUnits="s"),
  Grade=struct(UseTimeGradeBpts=0, Tbl=[0; 0], Bpts=[0; 17539.89], TblUnits="rad", BptUnits="m"),
  Gear=struct(Tbl=[1 1], Bpts=[0 1])), struct(
  Name="NREL_CILCC",
  VelRef=struct(
    Tbl=[0; 0; 0; 0; 0; 0; 0; 0; 0; 0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 0],
    Bpts=[0; 1; 2; 3; 4; 5; 6; 7; 8; 9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 3192],
    TblUnits="m/s",
    BptUnits="s"),
  Grade=struct(UseTimeGradeBpts=0, Tbl=[0; 0], Bpts=[0; 19825.24], TblUnits="rad", BptUnits="m"),
  Gear=struct(Tbl=[1 1], Bpts=[0 1])), struct(
  Name="HHDDT 65 cycle with grade from Danville to Starkville route",
  VelRef=struct(
    Tbl=[0; 0; 0; 0; 0; 0; 0; 0; 0; 0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 0],
    Bpts=[0; 1; 2; 3; 4; 5; 6; 7; 8; 9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 1904],
    TblUnits="m/s",
    BptUnits="s"),
  Grade=struct(
    UseTimeGradeBpts=0,
    Tbl=[0; 0; 0; 0; 0; 0; 0; 0; 0; 0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 0],
    Bpts=[2.044444; 4.702222; 7.155556; 9.608889; 12.32; 15.38667; 18.45333; 21.36889; 24.64; 28.06667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 42626.74],
    TblUnits="rad",
    BptUnits="m"),
  Gear=struct(Tbl=[1 1], Bpts=[0 1])), struct(
  Name="",
  VelRef=struct(
    Tbl=[0; 0; 0; 0.1692113; 0.4355751; 0.7797302; 1.177476; 1.551439; 1.828177; 2.009232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 0],
    Bpts=[0; 1; 2; 3.393502; 4.524669; 5.655836; 6.787003; 7.918171; 9.049338; 10.18051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 2101.61],
    TblUnits="m/s",
    BptUnits="s"),
  Grade=struct(
    UseTimeGradeBpts=0,
    Tbl=[0; 0; 0; 0; 0; 0; 0; 0; 0; 0.0008285875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 0],
    Bpts=[0; 0.6380208; 1.833767; 3.624132; 6.005859375; 8.74783; 11.54622; 14.296875; 16.8023; 19.833984375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 53828.39],
    TblUnits="rad",
    BptUnits="m"),
  Gear=struct(Tbl=[1 1], Bpts=[0 1]))]