% Simulink data dictionary TestDataDictionary.sldd

Param = Simulink.Parameter([])
Var2 = 0
Var3 = 0
Var4 = 0
Var = 0
Var1 = 0
ConfigSetDesktopFixedStep = Simulink.ConfigSet(StartTime="0", StopTime="inf", FixedStep="0.001", Solver="ode4", ProdHWDeviceType="Intel->x86-64 (Windows64)", SystemTargetFile="grt.tlc", TargetLang="C")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
ConfigSetDesktopVariableStep = Simulink.ConfigSet(StartTime="0", StopTime="inf", MaxStep=".01", RelTol="1e-3", Solver="ode23tb", ProdHWDeviceType="Intel->x86-64 (Windows64)", SystemTargetFile="grt.tlc", TargetLang="C")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