% Simulink data dictionary DdChassis.sldd

ChassisNumFrontWhls = 2
ChassisNumRearWhls = 2
ChassisDistCg2FrontAxle = 1.188
ChassisDistCg2RearAxle = 1.512
ChassisCgHeight = 0.5
ChassisVehMass = 1624
ChassisDragCoeff = 0.32
ChassisFrontalArea = 2.816123