% Simulink data dictionary DdDifferential.sldd

DiffCarrierInertia = 0.025
DiffAxleInertia = 0.01
DiffCarrierDamping = 0.001
DiffAxleCompCutoffFreq = 300
DiffAxleCompDamping = 400
DiffAxleCompStiffness = 10000
DiffAxleDamping = 0.001
DiffRatio = 7.05
DiffEff = 0.98