% Simulink data dictionary DdEvMotor.sldd

MtrTrqTimeCnst = 0.02
MtrEffSpdBpts = [0 1000 2000 2728.370453 3000 4000 5000 6000 7000 8000 9000 10000]

MtrEffTbl = [85 85 85 85 85 85 85 85 85 85 85 85 85 85 85
 85 85 85 85 85 85 85 85 85 85 85 85 85 85 85
 85 85 90 90 90 90 90 90 90 90 88 88 88 88 88
 85 85 92 92 92 92 92 92 92 92 92 90 90 90 90
 85 85 92 92 93 93 93 93 92 92 92 90 90 90 90
 85 85 93 94 94 94 94 94 94 94 94 94 94 94 94
 85 85 93 94 94 95 95 95 95 95 95 95 95 95 95
 85 85 93 94 94 95 95 95 95 95 95 95 95 95 95
 85 85 93 94 95 95 95 95 95 95 95 95 95 95 95
 85 85 93 94 95 95 95 95 95 95 95 95 95 95 95
 85 85 93 94 94 94 94 94 94 94 94 94 94 94 94
 85 85 90 92 93 93 93 93 93 93 93 93 93 93 93]

MtrInertia = 0.1
MtrTrqMax = 360
MtrEffTrqBpts = [0 25.71429 51.42857 77.14286 102.8571 128.5714 154.2857 180 205.7143 231.4286 257.1429 282.8571 308.5714 334.2857 360]
MtrPwrMax = 149000